% Simulink data dictionary interfaces.sldd

hwio_t = Simulink.ValueType(DataType="uint16", Min=0, Max=1000, be=Simulink.BusElement(Name="a", DataType="double"))
percent_t = Simulink.ValueType(DataType="single", be=Simulink.BusElement(Name="a", DataType="double"))

TPS_Percent = Simulink.Bus()  % Throttle position sensor values calculated as Percentage
  Value: ValueType: percent_t

APP_Percent = Simulink.Bus()  % Accelerator pedal position sensor values calculated as Percentage
  Value: ValueType: percent_t

Dem_IndicatorStatusType = enum(HeaderFile="Rte_Type.h", DefaultValue="DEM_INDICATOR_OFF", StorageType="uint8")
  DEM_INDICATOR_OFF = 0
  DEM_INDICATOR_CONTINUOUS = 1
  DEM_INDICATOR_BLINKING = 2
  DEM_INDICATOR_BLINK_CONT = 3
  DEM_INDICATOR_SLOW_FLASH = 4
  DEM_INDICATOR_FAST_FLASH = 5
  DEM_INDICATOR_ON_DEMAND = 6
  DEM_INDICATOR_SHORT = 7

Dem_EventStatusType = enum(HeaderFile="Rte_Type.h", DefaultValue="DEM_EVENT_STATUS_PASSED", StorageType="uint8")
  DEM_EVENT_STATUS_PASSED = 0
  DEM_EVENT_STATUS_FAILED = 1
  DEM_EVENT_STATUS_PREPASSED = 2
  DEM_EVENT_STATUS_PREFAILED = 3
  DEM_EVENT_STATUS_FDC_THRESHOLD_REACHED = 4

Dem_DTRControlType = enum(HeaderFile="Rte_Type.h", DefaultValue="DEM_DTR_CTL_NORMAL", StorageType="uint8")
  DEM_DTR_CTL_NORMAL = 0
  DEM_DTR_CTL_NO_MAX = 1
  DEM_DTR_CTL_NO_MIN = 2
  DEM_DTR_CTL_RESET = 3
  DEM_DTR_CTL_INVISIBLE = 4

Dem_DTCFormatType = enum(HeaderFile="Rte_Type.h", DefaultValue="DEM_DTC_FORMAT_OBD", StorageType="uint8")
  DEM_DTC_FORMAT_OBD = 0
  DEM_DTC_FORMAT_UDS = 1

Dem_DebouncingStateType = enum(HeaderFile="Rte_Type.h", DefaultValue="DEM_TEMPORARILY_DEFECTIVE", StorageType="uint8")
  DEM_TEMPORARILY_DEFECTIVE = 1
  DEM_FINALLY_DETECTIVE = 2
  DEM_TEMPORARILY_HEALED = 4
  DEM_TEST_COMPLETE = 8
  DEM_DTR_UPDATE = 16

Dem_OperationCycleStateType = enum(HeaderFile="Rte_Type.h", DefaultValue="DEM_CYCLE_STATE_START", StorageType="uint8")
  DEM_CYCLE_STATE_START = 0
  DEM_CYCLE_STATE_END = 1

Dem_IumprDenomCondStatusType = enum(HeaderFile="Rte_Type.h", DefaultValue="DEM_IUMPR_DEN_STATUS_NOT_REACHED", StorageType="uint8")
  DEM_IUMPR_DEN_STATUS_NOT_REACHED = 0
  DEM_IUMPR_DEN_STATUS_REACHED = 1
  DEM_IUMPR_DEN_STATUS_INHIBITED = 2

ThrCmd_HwIO = Simulink.Bus()  % Throttle command actuator values written to HW/IO
  Value: int16

NvM_RamBlockStatusType = enum(DefaultValue="NVM_RAMBLOCK_STATUS_UNITIALIZED", StorageType="uint8")
  NVM_RAMBLOCK_STATUS_UNITIALIZED = 0
  NVM_RAMBLOCK_STATUS_INVALID_UNCHANGED = 1
  NVM_RAMBLOCK_STATUS_VALID_CHANGED = 2
  NVM_RAMBLOCK_STATUS_VALID_UNCHANGED = 3

NvM_RequestResultType = enum(DefaultValue="NVM_REQ_OK", StorageType="uint8")
  NVM_REQ_OK = 0
  NVM_REQ_NOT_OK = 1
  NVM_REQ_PENDING = 2
  NVM_REQ_INTEGRITY_FAILED = 3
  NVM_REQ_BLOCK_SKIPPED = 4
  NVM_REQ_NV_INVALIDATED = 5
  NVM_REQ_CANCELED = 6
  NVM_REQ_REDUNDANCY_FAILED = 7
  NVM_REQ_RESTORED_FROM_ROM = 8

APP_HwIO = Simulink.Bus()  % Accelerator pedal position sensor values read from the HW/IO
  Elem1: ValueType: hwio_t

TPS_HwIO = Simulink.Bus()  % Throttle position sensor values read from the HW/IO
  Elem0: ValueType: hwio_t